# Grasshopper definition BeeHive_Test.gh (Grasshopper 1.0.7)

# ---- group: RH_IN:YCount
number_slider = Slider(10, range=5..50)

# ---- group: RH_IN:Size
number_slider_2 = Slider(0.5, range=0.5..1.5)

# ---- group: RH_IN:XCount
number_slider_3 = Slider(16, range=10..50)

# ----
pt = Point(Point(0, 0, 0))
xz = XZPlane(Origin=pt)
hexgrid = Hexagonal(Plane=xz, Size=number_slider_2, ExtentX=number_slider_3, ExtentY=number_slider)  # -> simplify(Cells), simplify(Points)
deplane = DeconstructPlane(Plane=xz)  # -> Origin, XAxis, YAxis, ZAxis
vec2pt = Vector2Pt(PointA=pt, PointB=hexgrid.Points, Unitize=False)  # -> Vector, Length
dprod = DotProduct(VectorA=deplane.XAxis, VectorB=vec2pt.Vector, Unitize=False)
map = BooleanToggle(True)
valmap = MapValues(values=dprod, T="0.05 to 0.18")
graph = GraphMapper(
    valmap,
    x0=0.05,
    x1=0.18,
    y0=0.05,
    y1=0.18,
    container_name="Bezier",
    cpx=[0, 0, 1, 1],
    cpy=[0, 0.6777663231, 0.4934775829, 1])
fillet = Fillet(Curve=hexgrid.Cells, Radius="0.1")
filter = StreamFilter(Gate=map, Stream0=valmap, Stream1=graph)
offset = OffsetCurve(Curve=hexgrid.Cells, Distance=expr("-x", filter), Plane=xz, Corners=1)
offset_2 = OffsetCurve(Curve=hexgrid.Cells, Distance=filter, Plane=xz, Corners=1)
len = Length(Curve=offset_2)
len_2 = Length(Curve=offset)
merge = Merge(Data1=offset_2, Data2=offset)
merge_2 = Merge(Data1=len, Data2=len_2)
sort = SortList(Keys=merge_2, ValuesA=merge)  # -> Keys, ValuesA
item = ListItem(List=sort.ValuesA, Index="0", Wrap=True)
pshift = ShiftPaths(Data=item, Offset=-1)
amp = Amplitude(Vector=deplane.ZAxis, Amplitude=expr("-x", filter))
fillet_2 = Fillet(Curve=pshift, Radius=filter)
move = Move(Geometry=fillet_2, Motion=amp)  # -> Geometry, Transform
merge_3 = Merge(Data1=graft(fillet), Data2=graft(move.Geometry))
c__loft = CSharpScript(C=merge_3)  # -> out, A; inputs C: tree of Curve
# ---------- c__loft: C# usings ----------
using System.Linq;
using System.Threading.Tasks;
# ---------- c__loft: C# ----------
    DataTree<LoftObj> objs = new DataTree<LoftObj>();

    for (int bi = 0;bi < C.BranchCount; bi++){
      var pth = C.Path(bi);
      var br = C.Branch(bi);
      objs.Add(new LoftObj(br), pth);
    }

    object locker = new object();
    Parallel.For(0, objs.BranchCount, bi => {
      LoftObj obj;
      lock (locker) obj = objs.Branch(bi)[0];
      obj.PerformLoft();
      });

    List<Brep> results = new List<Brep>();
    for (int bi = 0;bi < objs.BranchCount; bi++)
      results.AddRange(objs.Branch(bi)[0].lofted);
    A = results;
# ---------- c__loft: C# additional code ----------
  protected class LoftObj{

    public List<Curve> crvs = new List<Curve>();
    public LoftType lt;
    public Brep[] lofted;

    public LoftObj(IEnumerable<Curve> inputs){
      foreach (Curve c in inputs){
        crvs.Add(c.DuplicateCurve());
        lt = LoftType.Normal;
      }
    }
    public LoftObj(IEnumerable<Curve> inputs, LoftType type){
      foreach (Curve c in inputs){
        crvs.Add(c.DuplicateCurve());
        lt = type;
      }
    }

    public void PerformLoft(){
      lofted = Brep.CreateFromLoft(crvs, Point3d.Unset, Point3d.Unset, lt, false);
    }

  }
# ---------- end c__loft ----------
amp_2 = Amplitude(Vector=deplane.ZAxis, Amplitude="0.1")
extr = Extrude(Base=c__loft.A, Direction=amp_2)
c_script = CSharpScript(B=flatten(extr))  # -> out, A; inputs B: list of Brep
# ---------- c_script: C# ----------
    
    List<MeshingObj> objs = B.Select(b => new MeshingObj(b)).ToList();
    object locker = new object();
    Parallel.For(0, objs.Count, oi => {
      MeshingObj o;
      lock (locker) o = objs[oi];
      o.PerformMeshing();
      });
    
    List < Mesh > results = new List<Mesh>();
    foreach (MeshingObj o in objs)
      results.AddRange(o.meshes);
    A = results;
# ---------- c_script: C# additional code ----------
  protected class MeshingObj{

    public Brep src;
    public Mesh[] meshes;

    public MeshingObj(Brep b){
      src = b.DuplicateBrep();
    }

    public void PerformMeshing(){
      meshes = Mesh.CreateFromBrep(src, MeshingParameters.FastRenderMesh);
    }
  }
# ---------- end c_script ----------
preview = CustomPreview(
    Geometry=c_script.A,
    Material={diffuse=RGB(221, 160, 221), emission=RGB(66, 48, 66), shine=0.5, specular=RGB(255, 255, 255), transparency=0})

# ---- group: RH_OUT:Results
mesh = Mesh(c_script.A)

# ==== cluster MapValues: Map values to target domain
values = ClusterInput()  # values to map
T = ClusterInput()
sort = SortList(Keys=flatten(values))  # -> Keys, ValuesA
item = ListItem(List=sort.Keys, Index=0, Wrap=True)  # -> Item1, Item
dom = ConstructDomain(DomainStart=item.Item, DomainEnd=item.Item1)
remap = RemapNumbers(Value=values, Source=dom, Target=T)  # -> Mapped, Clipped
R = ClusterOutput(remap.Mapped)
